# Grasshopper definition preview.gh (Grasshopper 1.0.8)
# plug-ins: Wallacei

# NSGA II
# 挤出的长度
# 挤出的角度
# 旋转方向：垂直方向
# 
# 中间的点：线性过度
# 示意图 公式
# 不同参数下生成的样子
# excel
# csv
# numpy数据切片
panel = Panel("""1、搭建一个NSGA II多目标优化环境
2、设置参数，包括挤出的长度、角度（旋转方向）
3、考虑如何过度（先行过度）
4、把数据输入输出做成csv
5、用numpy做所有计算
6、用数据切片公式代替循环""")
genes = GenePool(
    Decimals=2,
    Maximum=0.001,
    Minimum=0,
    Value=[0.0004194333333, 0.0004124333333, 1.436666667e-05, 0.0004283666667, 0.0004579, 0.0001147333333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])
genes_2 = GenePool(Decimals=2, Maximum=100, Minimum=10, Value=[59.46, 24.26, 63.68, 93.91, 49.37, 37.5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])
genes_3 = GenePool(
    Decimals=2,
    Maximum=1,
    Minimum=0,
    Value=[0.4194333333, 0.4124333333, 0.01436666667, 0.4283666667, 0.4579, 0.1147333333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])
genes_4 = GenePool(Decimals=2, Maximum=5, Minimum=0.01, Value=[4.8, 1.13, 1.96, 2.02])
crv = Curve(<curve referenced from the Rhino model>)
divide = DivideCurve(Curve=crv, Count=Slider(50, range=0..10000), Kinks=False)  # -> Points, Tangents, Parameters
crv_2 = Curve(<curve referenced from the Rhino model>)  # disabled
pt = Point([<point referenced from the Rhino model> x4])
graft = GraftTree(Tree=genes_2, IncludeEmptyLists=True, IncludeNullItems=True)  # -> simplify(Tree)
graft_2 = GraftTree(Tree=genes, IncludeEmptyLists=True, IncludeNullItems=True)  # -> simplify(Tree)
graft_3 = GraftTree(Tree=genes_3, IncludeEmptyLists=True, IncludeNullItems=True)  # -> simplify(Tree)
c_script = CSharpScript(
    iStartingPositions=divide.Points,
    iRepellers=pt,
    iRepellerFactors=genes_4,
    iMaxCenterCount="200",
    iIterationCount=Slider(200, range=0..500),
    iCollisionDist=Slider(75, range=0..200))  # -> out, oCenters; inputs iStartingPositions: tree of Point3d, iRepellers: list of Point3d, iRepellerFactors: list of Double, iMaxCenterCount: Int32, iIterationCount: Int32, iCollisionDist: Double
# ---------- c_script: C# ----------
// Grasshopper Script Instance
#region Usings
using System;
using System.Linq;
using System.Collections;
using System.Collections.Generic;
using System.Drawing;

using Rhino;
using Rhino.Geometry;

using Grasshopper;
using Grasshopper.Kernel;
using Grasshopper.Kernel.Data;
using Grasshopper.Kernel.Types;
#endregion

public class Script_Instance : GH_ScriptInstance
{
    #region Notes
    /* 
      Members:
        RhinoDoc RhinoDocument
        GH_Document GrasshopperDocument
        IGH_Component Component
        int Iteration

      Methods (Virtual & overridable):
        Print(string text)
        Print(string format, params object[] args)
        Reflect(object obj)
        Reflect(object obj, string method_name)
    */
    #endregion

private void RunScript(
		DataTree<Point3d> iStartingPositions,
		List<Point3d> iRepellers,
		List<double> iRepellerFactors,
		int iMaxCenterCount,
		int iIterationCount,
		double iCollisionDist,
		ref object oCenters)
{
  double tileWidth = 1000.0;
  double tileHeight = 1000.0;
  double minFactor = 0.5;
  double maxFactor = 1.5;
  double maxEffectDist = 300.0;

  List<Point3d> centers = new List<Point3d>();
  List<int> centerPaths = new List<int>();
  for (int p = 0; p < iStartingPositions.BranchCount; p++)
  {
    var branch = iStartingPositions.Branch(p);
    foreach (var pt in branch)
    {
      centers.Add(pt);
      centerPaths.Add(p);
    }
  }

  List<Point3d> densityRepellers = new List<Point3d>(iRepellers);

  for (int iter = 0; iter < iIterationCount; iter++)
  {
    if (centers.Count >= iMaxCenterCount)
      break;

    List<Vector3d> totalMoves = new List<Vector3d>();
    List<double> collisionCounts = new List<double>();
    for (int i = 0; i < centers.Count; i++)
    {
      totalMoves.Add(Vector3d.Zero);
      collisionCounts.Add(0.0);
    }

    List<Point3d> mirroredPoints = new List<Point3d>();
    List<int> originalIndices = new List<int>();
    List<Vector2d> mirrorOffsets = new List<Vector2d>();
    RTree mirrorTree = new RTree();

    for (int dx = -1; dx <= 1; dx++)
    {
      for (int dy = -1; dy <= 1; dy++)
      {
        for (int i = 0; i < centers.Count; i++)
        {
          Point3d pt = new Point3d(
            centers[i].X + dx * tileWidth,
            centers[i].Y + dy * tileHeight,
            centers[i].Z);

          mirroredPoints.Add(pt);
          originalIndices.Add(i);
          mirrorOffsets.Add(new Vector2d(dx, dy));
          mirrorTree.Insert(pt, mirroredPoints.Count - 1);
        }
      }
    }

    for (int i = 0; i < centers.Count; i++)
    {
      List<int> neighbors = new List<int>();
      mirrorTree.Search(new Sphere(centers[i], iCollisionDist * maxFactor),
        (sender, args) =>
        {
          int idx = args.Id;
          if (originalIndices[idx] != i)
            neighbors.Add(idx);
        });

      foreach (int idx in neighbors)
      {
        int j = originalIndices[idx];
        Point3d mirrorJ = mirroredPoints[idx];

        Vector3d delta = centers[i] - mirrorJ;
        double d = delta.Length;
        if (d < 0.001) continue;

        double factorI = EvaluateDensityFactor(centers[i], densityRepellers, iRepellerFactors, minFactor, maxFactor, maxEffectDist);
        double factorJ = EvaluateDensityFactor(centers[j], densityRepellers, iRepellerFactors, minFactor, maxFactor, maxEffectDist);
        double localDist = iCollisionDist * 0.5 * (factorI + factorJ);

        if (d > localDist) continue;

        double pushStrength = 0.5 * (localDist - d);
        double maxStep = iCollisionDist * 0.5;
        pushStrength = Math.Min(pushStrength, maxStep);

        Vector3d move = delta;
        move.Unitize();
        move *= pushStrength;

        totalMoves[i] += move;
        totalMoves[j] -= move;

        collisionCounts[i] += 1.0;
        collisionCounts[j] += 1.0;
      }
    }

    for (int i = 0; i < centers.Count; i++)
    {
      if (collisionCounts[i] > 0.0)
        centers[i] += totalMoves[i] / collisionCounts[i];
    }

    if (centers.Count < iMaxCenterCount)
    {
      List<int> splitIndices = new List<int>();
      for (int i = 0; i < centers.Count - 1; i++)
      {
        if (centerPaths[i] != centerPaths[i + 1]) continue;

        double factorA = EvaluateDensityFactor(centers[i], densityRepellers, iRepellerFactors, minFactor, maxFactor, maxEffectDist);
        double factorB = EvaluateDensityFactor(centers[i + 1], densityRepellers, iRepellerFactors, minFactor, maxFactor, maxEffectDist);
        double insertThreshold = iCollisionDist * 0.5 * (factorA + factorB) - 1.0;

        if (centers[i].DistanceTo(centers[i + 1]) > insertThreshold)
          splitIndices.Add(i + 1 + splitIndices.Count);
      }

      foreach (int splitIndex in splitIndices)
      {
        Point3d newCenter = 0.5 * (centers[splitIndex - 1] + centers[splitIndex]);
        centers.Insert(splitIndex, newCenter);
        centerPaths.Insert(splitIndex, centerPaths[splitIndex - 1]);
        if (centers.Count >= iMaxCenterCount) break;
      }
    }
  }

  DataTree<Point3d> result = new DataTree<Point3d>();
  Dictionary<int, List<Point3d>> grouped = new Dictionary<int, List<Point3d>>();
  for (int i = 0; i < centers.Count; i++)
  {
    int pathId = centerPaths[i];
    if (!grouped.ContainsKey(pathId))
      grouped[pathId] = new List<Point3d>();
    grouped[pathId].Add(centers[i]);
  }
  foreach (var kv in grouped)
    result.AddRange(kv.Value, new GH_Path(kv.Key));

  oCenters = result;
}

// ✅ 密度控制函数（只靠近 repeller 时才变稀疏）
private double EvaluateDensityFactor(Point3d pt, List<Point3d> repellers, List<double> factors,
  double minF, double maxF, double maxD)
{
  if (repellers == null || repellers.Count == 0)
    return 1.0;

  double maxLocalFactor = 1.0;

  for (int i = 0; i < repellers.Count; i++)
  {
    double d = pt.DistanceTo(repellers[i]);
    if (d > maxD) continue;

    double t = d / maxD;
    double repellerStrength = factors[Math.Min(i, factors.Count - 1)];

    double localFactor = 1.0 + (maxF - 1.0) * repellerStrength * (1.0 - t);

    if (localFactor > maxLocalFactor)
      maxLocalFactor = localFactor;
  }

  return maxLocalFactor;
}

// ========== 附加函数：周期镜像向量 ==========
private Vector3d GetShortestDelta(Point3d a, Point3d b, double tileW, double tileH)
{
  Vector3d best = a - b;
  double bestDist = best.Length;

  for (int dx = -1; dx <= 1; dx++)
  {
    for (int dy = -1; dy <= 1; dy++)
    {
      if (dx == 0 && dy == 0) continue;

      Point3d wrappedB = new Point3d(
        b.X + dx * tileW,
        b.Y + dy * tileH,
        b.Z);

      Vector3d delta = a - wrappedB;
      double d = delta.Length;

      if (d < bestDist)
      {
        best = delta;
        bestDist = d;
      }
    }
  }

  return best;
}

}
# ---------- end c_script ----------
pdecon = Deconstruct(Point=pt)  # -> XComponent, YComponent, ZComponent
dup = DuplicateData(Data=graft, Number=Slider(5, range=0..10), Order=True)  # -> simplify(Data)
vec = VectorXYZ(XComponent=pdecon.XComponent, YComponent=pdecon.YComponent, ZComponent=pdecon.ZComponent)  # -> Vector, Length
dup_2 = DuplicateData(Data=graft_2, Number=Slider(5, range=0..10), Order=True)  # -> simplify(Data)
dup_3 = DuplicateData(Data=graft_3, Number=Slider(5, range=0..10), Order=True)  # -> simplify(Data)
flatten = FlattenTree(Tree=dup, Path="{0}")
flatten_2 = FlattenTree(Tree=dup_2, Path="{0}")
flatten_3 = FlattenTree(Tree=dup_3, Path="{0}")
pt_2 = Point(c_script.oCenters)
panel_2 = Panel(divide.Points)
pline = PolyLine(Vertices=pt_2, Closed=False)
intcrv = Interpolate(Vertices=pt_2, Degree=3, Periodic=False, KnotStyle=1)  # -> Curve, Length, Domain
divide_2 = DivideCurve(Curve=pline, Count=Slider(1999, range=0..10000), Kinks=False)  # -> Points, Tangents, Parameters
rotax = RotateAxis(Geometry=divide_2.Points, Angle=1.570796327, Axis=Line((0, 0, 0), (10, 0, 0)))  # -> Geometry, Transform
Y = UnitY(Factor=expr("-x", flatten))
c_script_2 = CSharpScript(fileName="resultsCrv.csv", folderName="results")  # -> filePath; inputs fileName: String, folderName: String
# ---------- c_script_2: C# ----------
// Grasshopper Script Instance
#region Usings
using System;
using System.IO;
using System.Linq;
using System.Collections;
using System.Collections.Generic;
using System.Drawing;

using Rhino;
using Rhino.Geometry;

using Grasshopper;
using Grasshopper.Kernel;
using Grasshopper.Kernel.Data;
using Grasshopper.Kernel.Types;
#endregion

public class Script_Instance : GH_ScriptInstance
{
    #region Notes
    /* 
      Members:
        RhinoDoc RhinoDocument
        GH_Document GrasshopperDocument
        IGH_Component Component
        int Iteration

      Methods (Virtual & overridable):
        Print(string text)
        Print(string format, params object[] args)
        Reflect(object obj)
        Reflect(object obj, string method_name)
    */
    #endregion

    private void RunScript(string fileName, string folderName, ref object filePath)
    {
        // 输入参数：folderName（可为空）、fileName（必须）、输出参数：fullPath
        string fullPath = "";

        // 获取 gh 文件路径
        string ghPath = Grasshopper.Instances.DocumentServer[0].FilePath;

        if (string.IsNullOrEmpty(ghPath))
        {
            Print("请先保存 Grasshopper 文件。");
        }
        else
        {
            // gh 文件所在目录（如 CrvGrowth/gh）
            string ghDir = System.IO.Path.GetDirectoryName(ghPath);

            // 工程根目录（即 CrvGrowth）
            string projectRoot = System.IO.Path.GetFullPath(Path.Combine(ghDir, ".."));

            // 判断是否指定了文件夹
            if (string.IsNullOrWhiteSpace(folderName))
            {
                // 没有指定文件夹，直接从根目录拼接文件名
                fullPath = Path.Combine(projectRoot, fileName);
            }
            else
            {
                // 指定了文件夹，从根目录 + 文件夹名 + 文件名拼接
                fullPath = Path.Combine(projectRoot, folderName, fileName);
            }

            // 标准化路径
            filePath = Path.GetFullPath(fullPath);
        }
    }
}
# ---------- end c_script_2 ----------
move = Move(Geometry=rotax.Geometry, Motion=Y)  # -> Geometry, Transform
xz = XZPlane(Origin=Point(0, 0, 0))
pi = Pi(Factor=flatten_2)
multiplication = Multiplication(A=flatten_2, B=Slider(21, range=0..100))
move_2 = Move(Geometry=move.Geometry, Motion=Vector(0, 0, 10))  # -> Geometry, Transform
pt_3 = PointPolar(BasePlane=move.Geometry, XYAngle=xz, ZAngle=pi, Offset=multiplication)

# ---- group: 平面生形结果 resultsCurve.csv
file = ReadFile(File=c_script_2, PerLineParse=True)
pdecon_2 = Deconstruct(Point=file)  # -> XComponent, YComponent, ZComponent
vec_2 = VectorXYZ(XComponent=pdecon_2.XComponent, YComponent=pdecon_2.YComponent, ZComponent=pdecon_2.ZComponent)  # -> Vector, Length
multiplication_2 = Multiplication(A=vec_2.Vector, B=Slider(100, range=0..100))
pt_4 = Point(vec_2.Vector)
pline_2 = PolyLine(Vertices=pt_4, Closed=False)
crv_3 = Curve(intcrv.Curve)
intcrv_2 = Interpolate(Vertices=pt_4, Degree=3, Periodic=False, KnotStyle=1)  # -> Curve, Length, Domain

# ----
series = Series(Start="8", Step="2", Count="5")
panel_3 = Panel("summer")
c_script_3 = CSharpScript(fileName="resultsLighting_winter.csv", folderName="results")  # -> filePath; inputs fileName: String, folderName: String; same code as c_script_2
c_script_4 = CSharpScript(moment=series, season="winter")  # -> filePath; inputs moment: Int32, season: String
# ---------- c_script_4: C# ----------
// Grasshopper Script Instance
#region Usings
using System;
using System.IO;
using System.Linq;
using System.Collections;
using System.Collections.Generic;
using System.Drawing;

using Rhino;
using Rhino.Geometry;

using Grasshopper;
using Grasshopper.Kernel;
using Grasshopper.Kernel.Data;
using Grasshopper.Kernel.Types;
#endregion

public class Script_Instance : GH_ScriptInstance
{
    #region Notes
    /* 
      Members:
        RhinoDoc RhinoDocument
        GH_Document GrasshopperDocument
        IGH_Component Component
        int Iteration

      Methods (Virtual & overridable):
        Print(string text)
        Print(string format, params object[] args)
        Reflect(object obj)
        Reflect(object obj, string method_name)
    */
    #endregion

    private void RunScript(int moment, string season, ref object filePath)
{
    // 获取 gh 文件路径
    string ghPath = Grasshopper.Instances.DocumentServer[0].FilePath;
    if (string.IsNullOrEmpty(ghPath))
    {
        Print("请先保存 Grasshopper 文件。");
        return;
    }

    // season 参数检查（只允许 summer 或 winter）
    season = season?.Trim().ToLower();
    if (season != "summer" && season != "winter")
    {
        Print("季节参数必须是 \"summer\" 或 \"winter\"。");
        return;
    }

    // gh 文件所在目录（如 CrvGrowth/gh）
    string ghDir = Path.GetDirectoryName(ghPath);

    // 工程根目录（即 CrvGrowth）
    string projectRoot = Path.GetFullPath(Path.Combine(ghDir, ".."));

    // 结果目录：projectRoot/results/tests_single_moment
    string resultsDir = Path.Combine(projectRoot, "results", "tests_single_moment");

    // 文件名：test_{moment}_{season}.csv
    string fileName = $"test_{moment}_{season}.csv";

    // 拼接完整路径
    string fullPath = Path.Combine(resultsDir, fileName);

    // 确保目录存在
    if (!Directory.Exists(resultsDir))
    {
        Directory.CreateDirectory(resultsDir);
    }

    // 输出路径
    filePath = Path.GetFullPath(fullPath);
}

}
# ---------- end c_script_4 ----------
nurbs = NurbsCurve(Vertices=rotax.Geometry, Degree=3, Periodic=False)  # -> Curve, Length, Domain
nurbs_2 = NurbsCurve(Vertices=pt_3, Degree=3, Periodic=False)  # -> Curve, Length, Domain
pdecon_3 = Deconstruct(Point=pt_4)  # -> XComponent, YComponent, ZComponent
rulesrf = RuledSurface(CurveA=nurbs.Curve, CurveB=nurbs_2.Curve)
file_2 = ReadFile(File=c_script_4, PerLineParse=True)  # -> simplify(Content)
pt_5 = ConstructPoint(XCoordinate=pdecon_3.XComponent, YCoordinate=0, ZCoordinate=pdecon_3.ZComponent)
dispatch = Dispatch(List=file_2, DispatchPattern=[True, False])  # -> ListA, ListB
pline_3 = PolyLine(Vertices=pt_4, Closed=False)
pline_4 = PolyLine(Vertices=pt_5, Closed=False)
flip = FlipMatrix(Data=dispatch.ListB)
number_slider = Slider(100, range=0..100)

# ---- group: 平面投影验证
number_slider_2 = Slider(0, range=0..100)  # disabled
number_slider_3 = Slider(1, range=0..1)  # disabled
number_slider_4 = Slider(100, range=0..100)  # disabled
neg = Negative(Value=number_slider_3)  # disabled
vec_3 = VectorXYZ(XComponent=number_slider_2, YComponent=number_slider_3, ZComponent=neg)  # -> Vector, Length; disabled
neg_2 = Negative(Value=number_slider_4)  # disabled
Y_2 = UnitY(Factor=number_slider_4)  # disabled
move_3 = Move(Geometry=intcrv_2.Curve, Motion=Y_2)  # -> Geometry, Transform; disabled
rulesrf_2 = RuledSurface(CurveA=move_3.Geometry, CurveB=intcrv_2.Curve)  # disabled
projecta = ProjectAlong(Geometry=rulesrf_2, Plane=PlaneXY(0, 0, 0), Direction=vec_3.Vector)  # -> Geometry, Transform; disabled

# ----
rulesrf_3 = RuledSurface(CurveA=pline_3, CurveB=pline_4)
ma = MassAddition(Input=flip)  # -> Result, PartialResults

# ---- group: 测试部分
panel_4 = Panel("/Users/yxy/Documents/CurveGrowthSystem/CrvGrowth/resultsMirroredFlat.csv")  # disabled
panel_5 = Panel("/Users/yxy/Documents/CurveGrowthSystem/CrvGrowth/resultsOriginalIndices.csv")  # disabled
number_slider_5 = Slider(0, range=0..8)  # disabled
number_slider_6 = Slider(50, range=0..100)  # disabled
number_slider_7 = Slider(0, range=0..49)  # disabled
file_3 = ReadFile(File=panel_4, PerLineParse=True)  # disabled
file_4 = ReadFile(File=panel_5, PerLineParse=True)  # disabled
number_slider_8 = Slider(100, range=0..100)  # disabled
number_slider_9 = Slider(20, range=0..20)  # disabled
pdecon_4 = Deconstruct(Point=file_3)  # -> XComponent, YComponent, ZComponent; disabled
multiplication_3 = Multiplication(A=number_slider_5, B=number_slider_6)  # disabled
pt_6 = Point(file_3)  # disabled
addition = Addition(A=multiplication_3, B=number_slider_7)  # disabled
item = ListItem(List=pt_6, Index=addition, Wrap=True)  # disabled
item_2 = ListItem(List=file_4, Index=addition, Wrap=True)  # disabled
panel_6 = Panel(item_2)  # disabled

# ----
flatten_4 = FlattenTree(Tree=ma.Result, Path="{0}")
panel_7 = Panel("""{5, 5, 0.0}
1
{15, 5, 0.0}
1
{25, 5, 0.0}
1
{35, 5, 0.0}
1
{45, 5, 0.0}
1
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""")
panel_8 = Panel("D:\00Study\CHN_JS_Nanjing.582380_TMYx.2004-2018\CHN_JS_Nanjing.582380_TMYx.2004-2018.epw")
toggle = BooleanToggle(False)  # disabled
epwmap = LBEPWmap(epw_map=toggle)  # -> report; disabled; plug-in component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
count = Integer("5")
start = Integer("8")
step = Integer("2")
rectangle = Rectangle(Plane=PlaneXY(0, 0, 0), XSize=Slider(1000, range=0..1000), YSize=Slider(1000, range=0..1000), Radius=0)  # -> Rectangle, Length
importloc = LBImportLocation(epw_file=panel_8)  # -> location; plug-in component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
series_2 = Series(Start=start, Step=step, Count=count)
series_3 = Series(Start=start, Step=step, Count=count)
series_4 = Series(Start=start, Step=step, Count=count)
series_5 = Series(Start=start, Step=step, Count=count)
boundary = BoundarySurfaces(Edges=rectangle.Rectangle)
analysisperiod = LBAnalysisPeriod(start_month="6", start_day="21", start_hour=series_2, end_month="6", end_day="21", end_hour=series_3)  # -> period, hoys, dates; plug-in component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
analysisperiod_2 = LBAnalysisPeriod(start_month="12", start_day="21", start_hour=series_4, end_month="12", end_day="21", end_hour=series_5)  # -> period, hoys, dates; plug-in component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
number_slider_10 = Slider(0, range=0..1000)
number_slider_11 = Slider(0.02, range=0..1)
number_slider_12 = Slider(500, range=0..1000)  # disabled

# ---- group: 检测太阳角度
panel_10 = Panel("<0.7817661, -0.08261535, -0.61807483>")  # disabled
panel_11 = Panel("<")  # disabled
rep = ReplaceText(Text=panel_10, Find=panel_11, RecursiveReplace=False)  # disabled
panel_12 = Panel(">")  # disabled
rep_2 = ReplaceText(Text=rep, Find=panel_12, RecursiveReplace=False)  # disabled
panel_13 = Panel(rep_2)  # disabled
number_slider_13 = Slider(50, range=0..100)  # disabled
number_slider_14 = Slider(0, range=0..100)  # disabled
number_slider_15 = Slider(100, range=0..100)  # disabled
vec_4 = Vector(panel_13)  # disabled
number_slider_16 = Slider(10, range=0..10)  # disabled
pt_7 = ConstructPoint(XCoordinate=number_slider_13, YCoordinate=expr("-x", number_slider_14), ZCoordinate=number_slider_15)  # disabled
multiplication_4 = Multiplication(A=pt_7, B=number_slider_16)  # disabled
multiplication_5 = Multiplication(A=vec_4, B=number_slider_12)  # disabled
vdis = VectorDisplay(Anchor=multiplication_4, Vector=multiplication_5)  # disabled

# ----
number_slider_17 = Slider(2000, range=0..10000)  # disabled
number_slider_18 = Slider(1, range=0..1)  # disabled
sunpath = LBSunPath(north=number_slider_10, location=importloc, hoys=analysisperiod.hoys, scale=number_slider_11)  # -> report, vectors, altitudes, azimuths, hoys, sun_pts, analemma, daily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; plug-in component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
sunpath_2 = LBSunPath(north=number_slider_10, location=importloc, hoys=analysisperiod_2.hoys, scale=number_slider_11)  # -> report, vectors, altitudes, azimuths, hoys, sun_pts, analemma, daily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; plug-in component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
pt_8 = ConstructPoint(XCoordinate=0, YCoordinate=number_slider_18, ZCoordinate=0)  # disabled
line = LineSDL(Start=multiplication_4, Direction=vec_4, Length=number_slider_17)  # disabled
lng = ListLength(List=sunpath.vectors)  # -> flatten(Length)
sunpath_3 = LBSunPath(north=pt_8, location=importloc, hoys=analysisperiod.hoys, scale=Slider(0.02, range=0..1))  # -> report, vectors, altitudes, azimuths, hoys, sun_pts, analemma, daily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; disabled; plug-in component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
addition_2 = Addition(A=lng, B=1)
colrange = LBColorRange(index="5")  # -> colors; plug-in component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
panel_14 = Panel("0")
item_3 = ListItem(List=addition_2, Index=0, Wrap=True)
Z = UnitZ(Factor=expr("-x", Slider(1000, range=0..1000)))
panel_15 = Panel(sunpath_3.sun_pts)  # disabled
legendpar = LBLegendParameters(seg_count=item_3, colors=flatten(colrange))  # -> leg_par; plug-in component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
move_4 = Move(Geometry=rulesrf_3, Motion=Z)  # -> Geometry, Transform
rectangle_2 = Rectangle(Plane=PlaneXY(0, 0, 0), XSize=Slider(4000, range=0..10000), YSize=Slider(2000, range=0..10000), Radius=0)  # -> Rectangle, Length
pt_9 = ConstructPoint(XCoordinate=0, YCoordinate=0, ZCoordinate=0)  # disabled
rotax_2 = RotateAxis(Geometry=rectangle_2.Rectangle, Angle=3.141592654, Axis=Line((0, 0, 0), (10, 0, 0)))  # -> Geometry, Transform
Z_2 = UnitZ(Factor=Slider(2000, range=0..10000))
flatten_5 = FlattenTree(Tree=sunpath_3.sun_pts, Path="{0}")  # disabled
boundary_2 = BoundarySurfaces(Edges=rectangle_2.Rectangle)
number_slider_19 = Slider(8, range=0..10)
boundary_3 = BoundarySurfaces(Edges=rotax_2.Geometry)
ln = Line(StartPoint=pt_9, EndPoint=flatten_5)  # disabled
toggle_2 = BooleanToggle(True)
shading_component = Brep(rulesrf_3)
move_5 = Move(Geometry=boundary_3, Motion=Z_2)  # -> Geometry, Transform
merge = Merge(Data1=move_4.Geometry, Data2=move_5.Geometry)  # -> flatten(Result)
flip_2 = Flip(Surface=boundary_3)  # -> Surface, Result
mesh = Mesh(shading_component)
geometry = Geometry(boundary)
directsunhours = LBDirectSunHours(
    vectors=flatten(sunpath.vectors),
    timestep="1",
    geometry=flatten(geometry),
    context=flatten(shading_component),
    grid_size="10",
    offset_dist="0.01",
    legend_par=flatten(legendpar),
    cpu_count=number_slider_19,
    run=toggle_2)  # -> report, points, simplify(results), mesh, legend, title, int_mtx; plug-in component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
directsunhours_2 = LBDirectSunHours(
    vectors=flatten(sunpath_2.vectors),
    geometry=flatten(geometry),
    context=flatten(shading_component),
    grid_size="10",
    offset_dist="0.01",
    legend_par=legendpar,
    cpu_count=number_slider_19,
    run=toggle_2)  # -> report, points, results, mesh, legend, title, int_mtx; plug-in component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
number_slider_20 = Slider(2000, range=0..10000)  # disabled
number_slider_21 = Slider(4000, range=0..10000)  # disabled
division = Division(A=number_slider_21, B="10")  # disabled
division_2 = Division(A=number_slider_20, B="10")  # disabled
larger = LargerThan(FirstNumber=flatten(directsunhours_2.results), SecondNumber="0")  # -> LargerThan, OrEqualTo; disabled
mjoin = MeshJoin(Meshes=directsunhours_2.mesh)  # disabled
multiplication_6 = Multiplication(A=division, B=division_2)  # disabled
X = UnitX(Factor=expr("-x", Slider(1200, range=0..10000)))
flatten_6 = FlattenTree(Tree=directsunhours.results, Path="{0}")
flatten_7 = FlattenTree(Tree=directsunhours_2.results, Path="{0}")
number_slider_22 = Slider(0.333, range=0..1)  # disabled
cullf = CullFaces(Mesh=mjoin, Pattern=larger.LargerThan)  # disabled
number_slider_23 = Slider(1, range=0..1)  # disabled
move_6 = Move(Geometry=directsunhours_2.mesh, Motion=X)  # -> Geometry, Transform
ma_2 = MassAddition(Input=flatten_7)  # -> Result, PartialResults
ma_3 = MassAddition(Input=flatten_6)  # -> Result, PartialResults
area = Area(Geometry=flatten(cullf))  # -> Area, Centroid; disabled
multiplication_7 = Multiplication(A=area.Area, B=number_slider_22)  # disabled
multiplication_8 = Multiplication(A=ma_3.Result, B=number_slider_23)  # disabled
multiplication_9 = Multiplication(A=ma_2.Result, B=number_slider_22)  # disabled
subtraction = Subtraction(A=multiplication_9, B=multiplication_8)  # disabled
neg_3 = Negative(Value=ma_2.Result)
wlc_summer = Integer(ma_3.Result)
wlc_winter = Integer(neg_3)
panel_16 = Panel(ma_2.Result)
panel_17 = Panel(ma_3.Result)
wallacei_x = WallaceiX(
    Genes=[genes_2, genes_4],
    Objectives=[wlc_summer, wlc_winter],
    allFitness="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",
    allFrontIdx="0|34;0|44",
    allGenomes="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",
    curFrontIdx="1|0;1|1",
    curFrontIdxSave="0|34;0|44;1|0;1|1",
    popGen="50,100",
    total="67406",
    wlcDone=True)  # -> WallaceiGenomes, FitnessValues, Data, WPhenotypes

# ---- group: 生成阴影网格
file_5 = ReadFile(File=c_script_3, PerLineParse=True)  # -> simplify(Content)
dispatch_2 = Dispatch(List=file_5, DispatchPattern=[True, False])  # -> ListA, ListB
division_3 = Division(A=Slider(10, range=0..10), B=Slider(2, range=0..10))
dom = ConstructDomain(DomainStart=expr("-x", division_3), DomainEnd=division_3)

# ----
flip_3 = FlipMatrix(Data=dispatch_2.ListA)
flip_4 = FlipMatrix(Data=dispatch_2.ListB)
item_4 = ListItem(List=flip_3, Index=0, Wrap=True)
ma_4 = MassAddition(Input=flip_4)  # -> Result, PartialResults
flatten_8 = FlattenTree(Tree=item_4, Path="{0}")
pt_10 = Point(flatten_8)
flatten_9 = FlattenTree(Tree=ma_4.Result, Path="{0}")
partition = PartitionList(List=pt_10, Size=number_slider)  # -> simplify(Chunks)
partition_2 = PartitionList(List=flatten_9, Size=number_slider)  # -> simplify(Chunks)
c_script_5 = CSharpScript(P=partition, Cell=Slider(10, range=0..10))  # -> Info, M; inputs P: tree of Point3d, Cell: Double
# ---------- c_script_5: C# ----------
// Grasshopper Script Instance
#region Usings
using System;
using System.Collections.Generic;
using Rhino;
using Rhino.Geometry;

using Grasshopper;
using Grasshopper.Kernel;
using Grasshopper.Kernel.Data;
using Grasshopper.Kernel.Types;
#endregion

public class Script_Instance : GH_ScriptInstance
{
  private void RunScript(DataTree<Point3d> P, double Cell, ref object M)
  {
    if (P == null || P.BranchCount == 0) { M = null; return; }
    if (Cell <= 0) { M = null; return; }

    double h = Cell * 0.5;
    var tree = new GH_Structure<GH_Mesh>();
    var path = new GH_Path(0);

    for (int b = 0; b < P.BranchCount; b++)
    {
      IList<Point3d> pts = P.Branch(b);
      for (int i = 0; i < pts.Count; i++)
      {
        Point3d c = pts[i];
        Mesh m = new Mesh();
        m.Vertices.Add(c.X - h, c.Y - h, c.Z);
        m.Vertices.Add(c.X + h, c.Y - h, c.Z);
        m.Vertices.Add(c.X + h, c.Y + h, c.Z);
        m.Vertices.Add(c.X - h, c.Y + h, c.Z);
        m.Faces.AddFace(0, 1, 2, 3);
        m.Normals.ComputeNormals();
        tree.Append(new GH_Mesh(m), path);
      }
    }

    M = tree;
  }
}
# ---------- end c_script_5 ----------
mesh_2 = Mesh(c_script_5.M)

# ---- group: 生成阴影网格 (continued)
pdecon_5 = Deconstruct(Point=flatten_8)  # -> XComponent, YComponent, ZComponent
vec_5 = VectorXYZ(XComponent=pdecon_5.XComponent, YComponent=pdecon_5.YComponent, ZComponent=pdecon_5.ZComponent)  # -> Vector, Length
bnd = Bounds(Numbers=flatten_9)
remap = RemapNumbers(Value=flatten_9, Source=bnd, Target=Domain(0, 1))  # -> Mapped, Clipped
rectangle_3 = Rectangle(Plane=vec_5.Vector, XSize=dom, YSize=dom, Radius=0)  # -> Rectangle, Length
xyz = ColourXYZ(Alpha=1, X=remap.Mapped, Y=remap.Mapped, Z=remap.Mapped)
preview = CustomPreview(Geometry=mesh_2, Material=xyz)
